# Grasshopper definition Demo_DrawItDoIt.gh (Grasshopper 1.0.6)
# plug-ins: Beaver

# Draw and Print
pipeline = GeometryPipeline(
    GroupByLayer=False,
    GroupByType=False,
    IncludeHidden=True,
    IncludeLocked=True,
    LayerFilter="Default",
    NameFilter="*",
    SublayerFiltering=True,
    TypeFilter=4)

# ---- group: How big id your printer?
number_slider = Slider(200, range=0..1000)
number_slider_2 = Slider(250, range=0..1000)

# ----
explode = Explode(Curve=pipeline, Recursive=True)  # -> Segments, Vertices
machinecreate = CreateMachine(SizeX=number_slider, SizeZ=number_slider_2, ParkPosition=Point(0, 0, 0))  # -> MachineConfiguration, Volume, Message
edges = BrepEdges(Brep=machinecreate.Volume)  # -> Naked, Interior, NonManifold
pathtranslate = TranslationPath(
    PathGeometry=explode.Vertices,
    ToolOrientation=PlaneXY(0, 0, 0),
    FeedRate=Slider(8000, range=0..10000),
    Configuration=machinecreate.MachineConfiguration,
    Tool=0)  # -> BeaverPath, Test
pathpreview = PathPreview(Path=flatten(pathtranslate.BeaverPath))  # -> Out, FeedRateRange, SPM
pathgcode = PathToGcode(Path=pathtranslate.BeaverPath, Precision=4, UseAbsolutePosition=True, UseAbsoluteE=True)  # -> Gcode, Message

# ---- group: Double click to start
toggle = BooleanToggle(False)

# ----
panel = Panel(pathgcode.Message)
panel_2 = Panel(pathgcode.Gcode)
wq = WriteQueue(String=panel_2, Send=toggle)
panel_3 = Panel(wq)
rw = ReadWrite()  # -> PrinterLogs, Queue
connect = ConnectToPrinter(Port="COM6", Baud=115200, Open=toggle)  # -> Message, Debug
panel_4 = Panel(rw.PrinterLogs)
panel_5 = Panel(connect.Message)
panel_6 = Panel(rw.Queue)
