# Grasshopper definition Demo_OSC.gh (Grasshopper 1.0.6)
# plug-ins: Beaver, gHowl

# ----
# TOUCHOSC
panel = Panel("192.168.1.92")
udp = UDPReceiver(Address=panel, Port="8000", Pattern="999")  # -> Info, Data
c_script = CSharpScript(OSC=udp.Data)  # -> Pt, X, Y, Z, A, B, C, K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; inputs OSC: list of String
# ---------- c_script: C# ----------
    string In = OSC[0].Remove(0, 1);
    double xyFactor = 0.2;
    double zFactor = 0.25;

    switch(In){
      case "XYpos":
        y = Convert.ToDouble(OSC[1]);
        y -= 500;
        y *= xyFactor;
        x = Convert.ToDouble(OSC[2]);
        x = 1000 - x;
        x -= 500;
        x *= xyFactor;
        x *= -1;
        break;
      case "Zpos":
        z = Convert.ToDouble(OSC[1]);
        z = 1000 - z;
        z *= zFactor;
        break;
      case "Apos":
        a = Convert.ToDouble(OSC[1]);
        break;
      case "Bpos":
        b = Convert.ToDouble(OSC[1]);
        break;
      case "Cpos":
        c = Convert.ToDouble(OSC[1]);
        break;
      case "KILL":
        k = Convert.ToInt32(OSC[1]);
        //k = 1 - k;
        break;
      case "Home":
        h = Convert.ToInt32(OSC[1]);
        break;
      case "F":
        f = Convert.ToDouble(OSC[1]);
        f *= 10000;
        break;
      case "acc":
        acc = Convert.ToBoolean(OSC[1]);
        break;
      case "accF":
        accf = Convert.ToDouble(OSC[1]);
        break;
      case "accxyz":
        double ax = Convert.ToDouble(OSC[1]);
        double ay = Convert.ToDouble(OSC[2]);
        double az = Convert.ToDouble(OSC[3]);
        accxyz = new Vector3d(ax, ay, az);
        break;
    }

    Pt = new Point3d(x, y, z);
    X = x;
    Y = y;
    Z = z;
    A = a;
    B = b;
    C = c;
    K = k;
    H = h;
    F = f;
    ACC = acc;
    ACCF = accf;
    ACCXYZ = accxyz;
# ---------- c_script: C# additional code ----------
  public double x = 0;
  public double y = 0;
  public double z = 0;
  public double a = 0;
  public double b = 0;
  public double c = 0;
  public int k = 0;
  public int h = 0;
  public double f = 1000;
  public bool acc = false;
  public double accf = 1.0;
  public Vector3d accxyz = new Vector3d(0, 0, 0);
# ---------- end c_script ----------
panel_2 = Panel(c_script.Pt)

# ---- group: How big id your printer?
number_slider = Slider(200, range=0..1000)
number_slider_2 = Slider(200, range=0..1000)

# ----
machinecreate = CreateMachine(SizeX=number_slider, SizeZ=number_slider_2, ParkPosition=Point(0, 0, 0))  # -> MachineConfiguration, Volume, Message
edges = BrepEdges(Brep=machinecreate.Volume)  # -> Naked, Interior, NonManifold
pathtranslate = TranslationPath(
    PathGeometry=c_script.Pt,
    ToolOrientation=PlaneXY(0, 0, 0),
    FeedRate=c_script.F,
    Configuration=machinecreate.MachineConfiguration,
    Tool=0)  # -> BeaverPath, Test
pathpreview = PathPreview(Path=flatten(pathtranslate.BeaverPath))  # -> Out, FeedRateRange, SPM
pathgcode = PathToGcode(Path=pathtranslate.BeaverPath, Precision=4, UseAbsolutePosition=True, UseAbsoluteE=True)  # -> Gcode, Message

# ---- group: Double click to enable
toggle = BooleanToggle(False)

# ----
panel_3 = Panel(pathgcode.Gcode)
panel_4 = Panel(pathgcode.Message)
bool = Boolean(c_script.K)
and = GateAnd(A=toggle, B=bool)
filter = StreamFilter(Gate=c_script.H, Stream0=panel_3, Stream1="G28")
wq = WriteQueue(String=filter, Send=and)
panel_5 = Panel(wq)
rw = ReadWrite()  # -> PrinterLogs, Queue
connect = ConnectToPrinter(Port="COM6", Baud=115200, Open=and)  # -> Message, Debug
panel_6 = Panel(rw.PrinterLogs)
panel_7 = Panel(connect.Message)
panel_8 = Panel(rw.Queue)
