# Grasshopper definition Demo_DrawItDoIt.gh (Grasshopper 1.0.7)
# plug-ins: Seastar

# Draw and Print
pipeline = GeometryPipeline(
    GroupByLayer=False,
    GroupByType=False,
    IncludeHidden=True,
    IncludeLocked=True,
    LayerFilter="Default",
    NameFilter="*",
    SublayerFiltering=True,
    TypeFilter=4)

# ---- group: How big id your printer?
number_slider = Slider(200, range=0..1000)
number_slider_2 = Slider(250, range=0..1000)

# ----
explode = Explode(Curve=pipeline, Recursive=True)  # -> Segments, Vertices
machinecreate = CreateMachine(
    SizeX=number_slider,
    SizeZ=number_slider_2,
    ParkPosition=Point(0, 0, 0),
    StartGcode="""M105 ; get extruder temp
M114 ; get position
T0
M20 ; SD card
M80 ; AXT power on
M220 S100 ; speed factor override
M221 S100 ; extrude factor override
M111 S6 ; Debug level 6
M155 S1 ; auto send temp
G28;Home""",
    EndGcode="""M105 ; get extruder temp
M114 ; get position
T0
M20 ; SD card
M80 ; AXT power on
M220 S100 ; speed factor override
M221 S100 ; extrude factor override
M111 S6 ; Debug level 6
M155 S1 ; auto send temp
G28;Home""")  # -> MachineConfiguration, Volume, Message
pathtranslate = TranslationPath(PathGeometry=explode.Vertices, ToolOrientation=PlaneXY(0, 0, 0), FeedRate=Slider(8000, range=0..10000), Tool=0)  # -> SeastarPath, Test
edges = BrepEdges(Brep=machinecreate.Volume)  # -> Naked, Interior, NonManifold
pathpreview = PathPreview(Path=flatten(pathtranslate.SeastarPath))  # -> Out, FeedRateRange, SPM
pathgcode = PathToGcode(
    Path=pathtranslate.SeastarPath,
    Precision=4,
    UseAbsolutePosition=True,
    UseAbsoluteE=True,
    ConfigurationMachine=machinecreate.MachineConfiguration)  # -> Gcode, Message

# ---- group: Double click to start
toggle = BooleanToggle(False)

# ----
panel = Panel(pathgcode.Message)
panel_2 = Panel(pathgcode.Gcode)
wq = WriteQueue(String=panel_2, Send=toggle)
panel_3 = Panel(wq)
rw = ReadWrite()  # -> PrinterLogs, Queue, Message
connect = ConnectToPrinter(Port="COM3", Baud=115200, Open=toggle)
panel_4 = Panel(rw.PrinterLogs)
panel_5 = Panel(connect)
panel_6 = Panel(rw.Queue)
