# Grasshopper definition Demo_LeapMotion.gh (Grasshopper 1.0.6)
# plug-ins: Firefly.X, Beaver

# ---- group: leapMoton Input
closing_threshold = Slider(3, range=0..10)
# Leap Motion Capture to BEAVER
number_slider = Slider(0.8, range=0..1)
leap = LeapFingerTracker(LeapSensorPlane=PlaneXY(0, 0, 0), ScaleFactor=number_slider)  # -> FingerTipPoints, VectorsFromFingers, FingerIDs, Joints, Bones, PalmPlane
item = ListItem(List=leap.FingerTipPoints, Index=0, Wrap=True)
item_2 = ListItem(List=leap.FingerTipPoints, Index=[1, 2, 3, 4], Wrap=True)
item_3 = ListItem(List=leap.FingerTipPoints, Index=1, Wrap=True)
dist = Distance(PointA=item, PointB=item_3)
multiplication = Multiplication(A=closing_threshold, B=number_slider, C=20)
dist_2 = Distance(PointA=leap.PalmPlane, PointB=item_2)
multiplication_2 = Multiplication(A=closing_threshold, B=number_slider, C=25)
smaller = SmallerThan(FirstNumber=dist_2, SecondNumber=multiplication_2)  # -> SmallerThan, OrEqualTo
smaller_2 = SmallerThan(FirstNumber=dist, SecondNumber=multiplication)  # -> SmallerThan, OrEqualTo
bang = ExplodeTree(Data=graft(smaller.SmallerThan))  # -> Branch0, Branch1, Branch2, Branch3
bang_2 = Bang(BooleanInput=smaller_2.SmallerThan)  # -> TrueState, FalseState
and = GateAnd(A=bang.Branch0, B=bang.Branch1, C=bang.Branch2, D=bang.Branch3)
bang_3 = Bang(BooleanInput=and)  # -> TrueState, FalseState

# ---- group: How big is your printer?
number_slider_2 = Slider(220, range=0..1000)
number_slider_3 = Slider(200, range=0..1000)

# ----
dom = ConstructDomain(DomainStart=Slider(50, range=0..100), DomainEnd=number_slider_2)
deplane = DeconstructPlane(Plane=leap.PalmPlane)  # -> Origin, XAxis, YAxis, ZAxis
machinecreate = CreateMachine(SizeX=number_slider_3, SizeZ=dom, ParkPosition=Point(0, 0, 0))  # -> MachineConfiguration, Volume, Message
pathtranslate = TranslationPath(
    PathGeometry=deplane.Origin,
    ToolOrientation=leap.PalmPlane,
    FeedRate=Slider(4800, range=0..10000),
    Configuration=machinecreate.MachineConfiguration,
    Tool=0)  # -> BeaverPath, Test
edges = BrepEdges(Brep=machinecreate.Volume)  # -> Naked, Interior, NonManifold
pathpreview = PathPreview(Path=flatten(pathtranslate.BeaverPath))  # -> Out, FeedRateRange, SPM
pathgcode = PathToGcode(Path=pathtranslate.BeaverPath, Precision=4, UseAbsolutePosition=True, UseAbsoluteE=True)  # -> Gcode, Message
panel = Panel(pathgcode.Gcode)
panel_2 = Panel(pathgcode.Message)

# ---- group: Double click to enable
toggle = BooleanToggle(False)

# ----
filter = StreamFilter(Gate=bang_2.TrueState, Stream1=panel)
filter_2 = StreamFilter(Gate=bang_3.TrueState, Stream1="G28")
wq = WriteQueue(String=[filter, filter_2], Send=toggle)
panel_3 = Panel(filter)
panel_4 = Panel(wq)
rw = ReadWrite()  # -> PrinterLogs, Queue
connect = ConnectToPrinter(Port="COM6", Baud=115200, Open=toggle)  # -> Message, Debug
panel_5 = Panel(rw.PrinterLogs)
panel_6 = Panel(connect.Message)
panel_7 = Panel(rw.Queue)
