# Grasshopper definition testConnect.gh (Grasshopper 1.0.7)
# plug-ins: Seastar

panel = Panel("""G0 X-51.54 Y-37.99 Z198.53 F4800
G0 X-16.73 Y2.34
G0 Z163.07
G0 X18.74
G0 X53.89 Y42.59
G0 X18.74 Y-37.99 Z127.96
G0 Y2.34 Z163.07
G0 Z198.53
G0 X-16.73
G0 Y42.66 Z234.00
G0 X54.20
G0 Z163.07
G0 X18.74 Y-37.99 Z127.60
G0 X-52.20
G0 Z198.53
G0 X-16.73 Y41.18 Z234.00
G4 P2000 
G0 X-51.88 Y-37.64 Z198.42
G0 X-16.73 Y2.38 Z198.53
G0 Y2.49 Z163.07
G0 X18.73 Y2.18
G0 X54.24 Y42.13 Z163.18
G0 X18.39 Y-38.04 Z127.84
G0 X18.73 Y2.18 Z163.06
G0 Y2.08 Z198.53
G0 X-16.73 Y2.38
G0 X-16.38 Y42.60 Z234.12
G0 X54.55 Y41.99
G0 Y42.20 Z163.18
G0 X18.39 Y-38.03 Z127.48
G0 X-52.55 Y-37.43
G0 Y-37.64 Z198.42
G0 X-16.39 Y41.12 Z234.12
G4 P2000 
G0 X-52.95 Y-36.51 Z198.06
G0 X-16.71 Y2.52 Z198.54
G0 Y2.97 Z163.08
G0 X18.72 Y1.68 Z163.05
G0 X55.32 Y40.63 Z163.54
G0 X17.26 Y-38.17 Z127.44
G0 X18.72 Y1.68 Z163.05
G0 Y1.24 Z198.52
G0 X-16.71 Y2.52 Z198.54
G0 X-15.24 Y42.37 Z234.51
G0 X55.64 Y39.80 Z234.46
G0 X55.63 Y40.69 Z163.54
G0 X17.26 Y-38.17 Z127.09
G0 X-53.63 Y-35.60 Z127.13
G0 X-53.62 Y-36.49 Z198.06
G0 X-15.30 Y40.89 Z234.49
G4 P2000 
G0 X-54.82 Y-34.38 Z197.44
G0 X-16.67 Y2.77 Z198.56
G0 X-16.66 Y3.83 Z163.11
G0 X18.67 Y0.78 Z163.03
G0 X57.17 Y37.83 Z164.14
G0 X15.21 Y-38.33 Z126.73
G0 X18.67 Y0.78 Z163.03
G0 X18.66 Y-0.28 Z198.48
G0 X-16.67 Y2.77 Z198.56
G0 X-13.21 Y41.87 Z235.21
G0 X57.46 Y35.76 Z235.05
G0 X57.48 Y37.88 Z164.14
G0 X15.21 Y-38.32 Z126.37
G0 X-55.46 Y-32.21 Z126.54
G0 X-55.49 Y-34.32 Z197.44
G0 X-13.34 Y40.40 Z235.16
G4 P2000 
G0 X-57.48 Y-30.92 Z196.56
G0 X-16.59 Y3.16 Z198.59
G0 X-16.50 Y5.15 Z163.18
G0 X18.50 Y-0.60 Z162.95
G0 X59.73 Y33.35 Z164.98
G0 X12.05 Y-38.35 Z125.64
G0 X18.50 Y-0.60 Z162.95
G0 X18.40 Y-2.60 Z198.36
G0 X-16.59 Y3.16 Z198.59
G0 X-10.14 Y40.89 Z236.26
G0 X59.85 Y29.37 Z235.80
G0 X60.05 Y33.37 Z164.98
G0 X12.05 Y-38.33 Z125.28
G0 X-57.94 Y-26.82 Z125.74
G0 X-58.14 Y-30.81 Z196.56
G0 X-10.38 Y39.43 Z236.17
G4 P2000 
G0 X-60.79 Y-25.62 Z195.47
G0 X-16.43 Y3.69 Z198.65""")
panel_2 = Panel("""G1 Z200 F1000
G1 Z220
G1 Z200
G1 Z220
G1 Z200
G1 Z220
G1 Z200
G1 Z220""")
connect = ConnectToPrinter(Port="COM3", Baud=250000, Open=Toggle(False))  # -> Message, Debug
wq = WriteQueue(String="G28   ; home", Send=Button())
rw = ReadWrite()  # -> PrinterLogs, Queue, Message
panel_3 = Panel(connect.Message)
panel_4 = Panel(connect.Debug)
panel_5 = Panel(rw.PrinterLogs)
panel_6 = Panel(rw.Queue)
panel_7 = Panel(rw.Message)
panel_8 = Panel(wq)
