# Grasshopper definition testMidi.gh (Grasshopper 1.0.6)
# plug-ins: Beaver

dom = ConstructDomain(DomainStart=0, DomainEnd=Slider(200, range=0..1000))
panel = Panel("C:\Users\antho\Google Drive (anthony@space10.io)\Kai-Hong Anthony Chu\Beaver\Portal_Still-Alive_acoccimi.mid")
panel_2 = Panel("C:\Users\antho\Google Drive (anthony@space10.io)\Kai-Hong Anthony Chu\Beaver")
machinecreate = CreateMachine(SizeX=dom, SizeZ=dom)  # -> Machine, Volume, Message
midi = MidiToGcode(FilePath=panel)  # -> G, C, CC, T
panel_3 = Panel(midi.CC)
branch = TreeBranch(Tree=midi.CC, Path="{0}", MaintainPaths=True)
filesave = FileSaver(
    FilePath=panel_2,
    FileName="stillAliveCh1",
    FileExtension=".txt",
    LinesOfText=midi.CC,
    OverwriteFile=Toggle(False),
    WriteFile=Button())
branch_2 = TreeBranch(Tree=midi.CC, Path="{1}", MaintainPaths=True)
branch_3 = TreeBranch(Tree=midi.CC, Path="{2}", MaintainPaths=True)
viewer = ParamViewer(midi.C)
addition = Addition(A=branch_3, B=Slider(300, range=0..1000))
addition_2 = Addition(A=branch_2, B=Slider(423, range=0..1000))
addition_3 = Addition(A=branch, B=Slider(164, range=0..1000))
jogcarriage = DeltaJogCarriage(XCarriage=addition_3, YCarriage=addition_2, ZCarriage=addition, DeltaMachine=machinecreate.Machine)  # -> Path, Message, Message_2
pathpreview = PathPreview(Path=flatten(jogcarriage.Path))  # -> Out, FeedRateRange
pathgcode = PathToGcode(Path=jogcarriage.Path)
filesave_2 = FileSaver()
