# Grasshopper definition testPreview.gh (Grasshopper 1.0.5)
# plug-ins: Beaver, Silkworm

number_slider = Slider(100, range=0..100)  # disabled
X = UnitX(Factor=number_slider)  # disabled
crv = Curve(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)  # disabled
move = Move(Geometry=crv, Motion=X)  # -> Geometry, Transform; disabled
number_slider_2 = Slider(100, range=0..100)  # disabled
number_slider_3 = Slider(100, range=0..100)  # disabled
number_slider_4 = Slider(200, range=0..1000)  # disabled
end = EndPoints(Curve=crv)  # -> Start, End; disabled
crv_2 = Curve([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])
explode = Explode(Curve=move.Geometry, Recursive=True)  # -> Segments, Vertices; disabled
pt = Point(end.Start)  # disabled
end_2 = EndPoints(Curve=crv_2)  # -> Start, End
explode_2 = Explode(Curve=crv, Recursive=True)  # -> Segments, Vertices; disabled
lng = ListLength(List=explode_2.Vertices)  # disabled
series = Series(Start=0, Step=number_slider_2, Count=lng)  # disabled
series_2 = Series(Start=number_slider_4, Step=number_slider_3, Count=lng)  # disabled
sort_pt = SortPoints(Points=end_2.Start)  # -> Points, Indices
entwine = Entwine(Branch00=series, Branch01=series_2, FlattenInputs=True)  # disabled
item = ListItem(List=crv_2, Index=sort_pt.Indices, Wrap=True)
entwine_2 = Entwine(Branch00=explode_2.Vertices, Branch01=explode.Vertices, FlattenInputs=True)  # disabled
segmenter = Segmenter(
    Curves=item,
    MainSegmentCount=0,
    SubSegmentCount=0,
    MaxAngleRadians=Slider(0.29, range=0..1),
    MaxChordLengthRatio=0.1,
    MaxAspectRatio=0,
    Tolerance=0,
    MinEdgeLength=0.1,
    MaxEdgeLength=0,
    KeepStartPoint=True)
pathtranslate = TranslationPath(PathGeometry=entwine_2, ToolOrientation=PlaneXY(0, 0, 0), FeedRate=entwine)  # -> BeaverPath, Test; disabled
xy = XYPlane(Origin=Point(0, 0, 0))
pathpreview = PathPreview(Path=flatten(pathtranslate.BeaverPath))  # -> Out, FeedRateRange; disabled
explode_3 = Explode(Curve=segmenter, Recursive=True)  # -> Segments, Vertices
dist = Distance(PointA=explode_3.Vertices, PointB=xy)
pathtranslate_2 = TranslationPath(PathGeometry=explode_3.Vertices, ToolOrientation=PlaneXY(0, 0, 0), FeedRate=dist)  # -> BeaverPath, Test
pathgcode = PathToGcode(Path=pathtranslate_2.BeaverPath)
pathpreview_2 = PathPreview(Path=flatten(pathtranslate_2.BeaverPath))  # -> Out, FeedRateRange
panel = Panel(pathgcode)
