# Grasshopper definition testSim.gh (Grasshopper 1.0.6)
# plug-ins: Seastar

crv = Curve(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)
explode = Explode(Curve=crv, Recursive=True)  # -> Segments, Vertices
pathtranslate = TranslationPath(PathGeometry=explode.Vertices, ToolOrientation=PlaneXY(0, 0, 0), FeedRate=Slider(1200, range=0..10000), Tool=0)  # -> SeastarPath, Test
pathsim = SimulatePaths(SeastarPath=flatten(pathtranslate.SeastarPath), Time=Slider(1, range=0..1), PlaybackSpeed=Slider(1, range=0..1))
