# Grasshopper definition testLogo.gh (Grasshopper 1.0.6)
# plug-ins: Beaver

# ----
# Rotation increment
number_slider = Slider(0, range=0..100)
dom = ConstructDomain(DomainStart=number_slider, DomainEnd=Slider(360, range=0..1000))
range = Range(Domain=dom, Steps=Slider(18, range=0..100))
rad = Radians(Degrees=range)

# ----
# Logo Path
crv = Curve(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)
# Rotational Axis
crv_2 = Curve(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)
line = Line(crv_2)
eval = EvaluateLength(Curve=line, Length=0.5, Normalized=True)  # -> Point, Tangent, Parameter
rot3d = Rotate3D(Geometry=crv, Angle=rad, Center=eval.Point, Axis=line)  # -> Geometry, Transform
m_command = MCommand({"Unconditional_Stop": 0, "Sleep": 1, "Program_End": 2, "Spindle_On_CW": 3, "Spindle_On_CCW": 4, "Spindle_Off": 5, "Auto_Tool_Change": 6, "Coolant_On_Mist": 7, "Coolant_On_Flood": 8, "Coolant_Off": 9, "Vacuum_On": 10, "Vacuum_Off": 11, "Enable_all_stepper_motor": 17, "Diable_all_stepper_motor": 18, "List_SD_card": 20, "Initialize_SD_card": 21, "Switch_IO_pin": 22, "Dwell": -4}, selected="Dwell")
explode = Explode(Curve=rot3d.Geometry, Recursive=True)  # -> Segments, Vertices
pathtranslate = TranslationPath(PathGeometry=flatten(explode.Vertices), ToolOrientation=PlaneXY(0, 0, 0), FeedRate=Slider(4800, range=0..10000))  # -> BeaverPath, Test
lng = ListLength(List=explode.Vertices)  # -> flatten(Length)
mcommand = MCommand(CommandType=m_command, PValue=Slider(2000, range=0..10000))  # -> ActionBlock, Message, Test
ma = MassAddition(Input=lng)  # -> Result, PartialResults
pathinsert = InsertPaths(BeaverPath=pathtranslate.BeaverPath, Index=ma.PartialResults, PathOrAction=mcommand.ActionBlock)
# Click to save file!
button = Button()
pathpreview = PathPreview(Path=flatten(pathinsert))  # -> Out, FeedRateRange
pathgcode = PathToGcode(Path=pathinsert, Precision=2, UseAbsolutePosition=True, UseAbsoluteE=True)  # -> flatten(Gcode), Message
panel = Panel(pathgcode.Gcode)
filesave = FileSaver(
    FilePath="C:\Users\antho\Google Drive (anthony@space10.io)\Kai-Hong Anthony Chu\Beaver\testGcode",
    FileName="space10_Logo",
    FileExtension=".gcode",
    LinesOfText=pathgcode.Gcode,
    OverwriteFile=False,
    WriteFile=button)
