# Grasshopper definition testMidi_2.gh (Grasshopper 1.0.6)
# plug-ins: TTToolbox, Beaver

panel = Panel("C:\Users\antho\Google Drive (anthony@space10.io)\Kai-Hong Anthony Chu\05_sampleTasks\Midi\Portal_Still-Alive_acoccimi.mid")
panel_2 = Panel("""0
1
2""")
midi = ReadMidi(FilePath=panel)  # -> CC, Ch, Nt, St, Dr
midi_2 = ReadMidi(FilePath=panel)  # -> CC, Ch, Nt, St, Dr, S
convert_note_number_to_f_mm_min = Panel("(2^((x-69)/12))*440*60/80")
panel_3 = Panel(midi_2.S)
tb = TreeBranch(DataTree=midi.St, BranchIndex=panel_2)
tb_2 = TreeBranch(DataTree=midi.Nt, BranchIndex=panel_2)
tb_3 = TreeBranch(DataTree=midi.Dr, BranchIndex=panel_2)
shift = ShiftList(List=tb, Shift=1, Wrap=False)
eval = Evaluate(F=convert_note_number_to_f_mm_min, x=tb_2)
subtraction = Subtraction(A=shift, B=tb)
f_mm_min = Panel(eval)
division = Division(A=eval, B=60)
division_2 = Division(A=subtraction, B=1000)

# ---- group: Printer Control
connect = ConnectToPrinter(Port="COM6", Baud=115200, Open=Toggle(False))  # -> Message, Debug; disabled
rw = ReadWrite()  # -> PrinterLogs, Queue; disabled
panel_4 = Panel(rw.PrinterLogs)  # disabled
panel_5 = Panel(connect.Message)  # disabled
panel_6 = Panel(rw.Queue)  # disabled

# ----
f_mm_s = Panel(division)
multiplication = Multiplication(A=division_2, B=Slider(0.6, range=0..1))
multiplication_2 = Multiplication(A=division, B=multiplication)
axis_max = Panel("200")
traveldist_mm = Panel(multiplication_2)
ma = MassAddition(Input=multiplication_2)  # -> Result, PartialResults
subtraction_2 = Subtraction(A=axis_max, B=ma.PartialResults)
number_slider = Slider(6, range=0..100)
pt = ConstructPoint(XCoordinate=subtraction_2, YCoordinate=0, ZCoordinate=0)
split = SplitList(List=pt, Index=number_slider)  # -> ListA, ListB
split_2 = SplitList(List=eval, Index=number_slider)  # -> ListA, ListB
panel_7 = Panel("G28")
panel_8 = Panel("G1 X100 F588 ; note79 G5")
pathtranslate = TranslationPath(PathGeometry=split.ListA, ToolOrientation=PlaneXY(0, 0, 0), FeedRate=split_2.ListA)  # -> BeaverPath, Test
pathgcode = PathToGcode(Path=pathtranslate.BeaverPath, Precision=4, UseAbsolutePosition=True, UseAbsoluteE=True)  # -> Gcode, Message
button = Button()  # disabled
wq = WriteQueue(String=pathgcode.Gcode, Send=button)  # disabled
panel_9 = Panel(pathgcode.Gcode)  # disabled
