# Grasshopper definition testSPM.gh (Grasshopper 1.0.6)
# plug-ins: Beaver

number_slider = Slider(100, range=0..100)
rad = Radians(Degrees=Slider(0, range=0..100))
rad_2 = Radians(Degrees=Slider(0, range=0..100))
rad_3 = Radians(Degrees=Slider(0, range=0..1000))
eulerplane = PlaneFromEulerAngle(Alpha=rad_3, Beta=rad_2, Gamma=rad)
rotateplane = PlaneFromLocalRotation(XRotation=Slider(-13, range=-100..100), YRotation=Slider(-34, range=-100..100), ZRotation=Slider(0, range=0..1000))
number_slider_2 = Slider(84, range=0..1000)
xy = XYPlane(Origin=Point(0, 0, 0))
number_slider_3 = Slider(10, range=0..10)  # disabled
toolcreatespm = CreateSPMTool(
    TargetPlane=rotateplane,
    Alpha1=Slider(60, range=0..100),
    Alpha2=Slider(90, range=0..100),
    Gamma=Slider(0.01, range=0..0.01),
    Beta=Slider(75, range=0..100),
    Radius=number_slider_2)  # -> LinkageArc, Axes, InitialAngle, SPMAxes, Message
amp = Amplitude(Vector=toolcreatespm.Axes, Amplitude=number_slider_2)  # disabled
line = LineSDL(Start=amp, Direction=Vector(0, 0, 1), Length=number_slider_3)  # disabled
item = ListItem(List=reverse(line), Index=0, Wrap=True)  # disabled
end = EndPoints(Curve=item)  # -> Start, End; disabled
pline = PolyLine(Vertices=flatten(end.Start), Closed=True)  # disabled
boundary = BoundarySurfaces(Edges=pline)  # disabled
