# Grasshopper definition testSPM_2.gh (Grasshopper 1.0.6)
# plug-ins: Seastar, Silkworm

number_slider = Slider(100, range=0..100)
rad = Radians(Degrees=Slider(0, range=0..100))
rad_2 = Radians(Degrees=Slider(0, range=0..100))
rad_3 = Radians(Degrees=Slider(0, range=0..1000))
eulerplane = PlaneFromEulerAngle(Alpha=rad_3, Beta=rad_2, Gamma=rad)
vec = VectorXYZ(XComponent=0, YComponent=Slider(0, range=0..100), ZComponent=Slider(8.9, range=0..100))  # -> Vector, Length
vec_2 = VectorXYZ(XComponent=0, YComponent=Slider(0, range=0..100), ZComponent=Slider(6.3, range=0..100))  # -> Vector, Length
number_slider_2 = Slider(20, range=0..1000)
crv = Curve(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)
segmenter = Segmenter(
    Curves=crv,
    MainSegmentCount=Slider(4, range=0..10),
    SubSegmentCount=0,
    MaxAngleRadians=Slider(1.2, range=0..10),
    MaxChordLengthRatio=0.1,
    MaxAspectRatio=0,
    Tolerance=0,
    MinEdgeLength=0.1,
    MaxEdgeLength=0,
    KeepStartPoint=True)
rotateplane = PlaneFromLocalRotation(
    Plane=Plane(origin=(0, 0, 0), x=(-1, 0, 0), y=(0, 1, 0)),
    XRotation=Slider(6, range=-100..100),
    YRotation=Slider(-42, range=-100..100),
    ZRotation=Slider(0, range=0..1000))
explode = Explode(Curve=segmenter, Recursive=True)  # -> Segments, Vertices
crv_cp = CurveClosestPoint(Point=explode.Vertices, Curve=crv)  # -> Point, Parameter, Distance
axescreatespherical = CreateSphericalAxes(
    HomePlane=Plane(origin=(0, 0, 0), x=(-1, 0, 0), y=(0, 1, 0)),
    TargetPlane=rotateplane,
    ARange=Domain(-3.141592654, 3.141592654),
    BRange=Domain(-3.141592654, 3.141592654),
    CRange=Domain(-3.141592654, 3.141592654),
    RotationalSystem=8,
    Radius=number_slider_2,
    PlaneOffset=vec_2.Vector,
    MountingOffset=vec.Vector)  # -> Axes, AxisAngles, SphericalAxes, OffsetPlane, MountingPlane, Message
axescreatespm = CreateSPMAxes(
    HomePlane=Plane(origin=(0, 0, 0), x=(-1, 0, 0), y=(0, 1, 0)),
    TargetPlane=rotateplane,
    Alpha1=Slider(45, range=0..100),
    Alpha2=Slider(90, range=0..100),
    Gamma=Slider(0, range=0..100),
    Beta=Slider(80, range=0..100),
    Radius=number_slider_2,
    PlaneOffset=vec_2.Vector,
    MountingOffset=vec.Vector)  # -> LinkageArc, Axes, InitialAngle, SPMAxes, OffsetPlane, MountingPlane, WorkSpace, Message
xy = XYPlane(Origin=Point(0, 0, 0))
eval = EvaluateCurve(Curve=crv, Parameter=crv_cp.Parameter)  # -> Point, Tangent, Angle
pframe = PerpFrame(Curve=crv, Parameter=crv_cp.Parameter)
Z = UnitZ(Factor=1)
panel = Panel(axescreatespm.InitialAngle)
vec2pt = Vector2Pt(PointA=crv_cp.Point, PointB=xy, Unitize=False)  # -> Vector, Length
rev = Reverse(Vector=Z)
pl = PlaneNormal(Origin=crv_cp.Point, ZAxis=vec2pt.Vector)
machinecreate = CreateMachine(
    SizeX=Slider(200, range=0..1000),
    SizeZ=Slider(250, range=0..1000),
    ParkPosition=Point(0, 0, 0),
    RotationalAxes=axescreatespm.SPMAxes)  # -> MachineConfiguration, Volume, Message
align = AlignPlane(Plane=pl, Direction=eval.Tangent)  # -> Plane, Angle
item = ListItem(List=align.Plane, Index=0, Wrap=True)
edges = BrepEdges(Brep=machinecreate.Volume)  # -> Naked, Interior, NonManifold
pathtranslate = TranslationPath(
    PathGeometry=crv_cp.Point,
    ToolOrientation=align.Plane,
    FeedRate=3600,
    Configuration=machinecreate.MachineConfiguration,
    Tool=0)  # -> BeaverPath, Test
pathpreview = PathPreview(Path=flatten(pathtranslate.BeaverPath))  # -> Out, FeedRateRange, SPM
