# Grasshopper definition testSpiral.gh (Grasshopper 1.0.6)
# plug-ins: Beaver, GrasshopperCs, Primate1

crv = Curve(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)
divide = DivideCurve(Curve=crv, Count=Slider(500, range=0..10000), Kinks=False)  # -> Points, Tangents, Parameters
pathtranslate = TranslationPath(PathGeometry=divide.Points, ToolOrientation=PlaneXY(0, 0, 0), FeedRate=Slider(4800, range=0..10000))  # -> BeaverPath, Test
panel = Panel("C:\Users\antho\Google Drive (anthony@space10.io)\Kai-Hong Anthony Chu\Beaver\testGcode")
pathgcode = PathToGcode(Path=pathtranslate.BeaverPath, Precision=4, UseAbsolutePosition=True, UseAbsoluteE=True)  # -> Gcode, Message
panel_2 = Panel(pathgcode.Gcode)
filesave = FileSaver(
    FilePath=panel,
    FileName="test2",
    FileExtension=".gcode",
    LinesOfText=pathgcode.Gcode,
    OverwriteFile=Toggle(False),
    WriteFile=Button())
knob = ControlKnob(Decimals=2, Limit=True, Maximum=200, Minimum=0, Range=1, Value=0)
knob_2 = ControlKnob(Decimals=2, Limit=True, Maximum=200, Minimum=0, Range=1, Value=0)
knob_3 = ControlKnob(Decimals=2, Limit=True, Maximum=200, Minimum=0, Range=1, Value=101.17)
panel_3 = Panel("""G0 Y37.5244 Z19.8017 F4800
G0 X-7.0397 Y36.9726 Z20.0264
G0 X-13.8523 Y35.1152 Z20.2505
G0 X-20.2000 Y32.0215 Z20.4739
G0 X-25.8626 Y27.8026 Z20.6966
G0 X-30.6461 Y22.6080 Z20.9187
G0 X-34.3882 Y16.6193 Z21.1402
G0 X-36.9636 Y10.0440 Z21.3610
G0 X-38.2881 Y3.1076 Z21.5812
G0 X-38.3203 Y-3.9542 Z21.8007
G0 X-37.0628 Y-10.9033 Z22.0196
G0 X-34.5611 Y-17.5074 Z22.2379
G0 X-30.9020 Y-23.5476 Z22.4556
G0 X-26.2098 Y-28.8256 Z22.6727
G0 X-20.6417 Y-33.1698 Z22.8892
G0 X-14.3824 Y-36.4405 Z23.1051
G0 X-7.6375 Y-38.5342 Z23.3204
G0 X-0.6266 Y-39.3861 Z23.5351
G0 X6.4238 Y-38.9723 Z23.7492
G0 X13.2878 Y-37.3093 Z23.9628
G0 X19.7473 Y-34.4535 Z24.1758
G0 X25.5988 Y-30.4983 Z24.3882
G0 X30.6593 Y-25.5714 Z24.6000
G0 X34.7724 Y-19.8297 Z24.8113
G0 X37.8122 Y-13.4544 Z25.0220
G0 X39.6872 Y-6.6448 Z25.2322
G0 X40.3426 Y0.3878 Z25.4418
G0 X39.7613 Y7.4269 Z25.6509
G0 X37.9643 Y14.2577 Z25.8594
G0 X35.0091 Y20.6730 Z26.0675
G0 X30.9881 Y26.4801 Z26.2749
G0 X26.0249 Y31.5058 Z26.4819
G0 X20.2702 Y35.6016 Z26.6883
G0 X13.8974 Y38.6479 Z26.8942
G0 X7.0967 Y40.5572 Z27.0996
G0 X0.0698 Y41.2758 Z27.3045
G0 X-6.9769 Y40.7856 Z27.5089
G0 X-13.8375 Y39.1038 Z27.7128
G0 X-20.3133 Y36.2823 Z27.9162
G0 X-26.2180 Y32.4052 Z28.1191
G0 X-31.3832 Y27.5866 Z28.3215
G0 X-35.6629 Y21.9666 Z28.5234
G0 X-38.9371 Y15.7073 Z28.7248
G0 X-41.1155 Y8.9875 Z28.9257
G0 X-42.1392 Y1.9980 Z29.1262
G0 X-41.9822 Y-5.0644 Z29.3262
G0 X-40.6515 Y-12.0022 Z29.5257
G0 X-38.1870 Y-18.6226 Z29.7247
G0 X-34.6594 Y-24.7431 Z29.9233
G0 X-30.1684 Y-30.1961 Z30.1214
G0 X-24.8394 Y-34.8338 Z30.3191
G0 X-18.8198 Y-38.5311 Z30.5163
G0 X-12.2747 Y-41.1900 Z30.7131
G0 X-5.3824 Y-42.7406 Z30.9094
G0 X1.6707 Y-43.1438 Z31.1052
G0 X8.6951 Y-42.3913 Z31.3006
G0 X15.5036 Y-40.5057 Z31.4956
G0 X21.9156 Y-37.5397 Z31.6902
G0 X27.7624 Y-33.5741 Z31.8843
G0 X32.8913 Y-28.7155 Z32.0779
G0 X37.1694 Y-23.0932 Z32.2712
G0 X40.4870 Y-16.8556 Z32.4640
G0 X42.7598 Y-10.1662 Z32.6564
G0 X43.9313 Y-3.1990 Z32.8484
G0 X43.9738 Y3.8660 Z33.0400
G0 X42.8885 Y10.8472 Z33.2311
G0 X40.7056 Y17.5667 Z33.4218
G0 X37.4829 Y23.8541 Z33.6122
G0 X33.3042 Y29.5511 Z33.8021
G0 X28.2768 Y34.5153 Z33.9916
G0 X22.5288 Y38.6237 Z34.1807
G0 X16.2052 Y41.7752 Z34.3694
G0 X9.4648 Y43.8935 Z34.5578
G0 X2.4755 Y44.9282 Z34.7457
G0 X-4.5896 Y44.8559 Z34.9332
G0 X-11.5567 Y43.6807 Z35.1204
G0 X-18.2554 Y41.4337 Z35.3071
G0 X-24.5230 Y38.1717 Z35.4935
G0 X-30.2081 Y33.9762 Z35.6795
G0 X-35.1744 Y28.9503 Z35.8651
G0 X-39.3038 Y23.2168 Z36.0504
G0 X-42.4988 Y16.9146 Z36.2352
G0 X-44.6850 Y10.1955 Z36.4197
G0 X-45.8123 Y3.2202 Z36.6038
G0 X-45.8563 Y-3.8456 Z36.7876
G0 X-44.8179 Y-10.8348 Z36.9710
G0 X-42.7237 Y-17.5832 Z37.1540
G0 X-39.6248 Y-23.9335 Z37.3367
G0 X-35.5955 Y-29.7380 Z37.5190
G0 X-30.7310 Y-34.8631 Z37.7009
G0 X-25.1457 Y-39.1914 Z37.8825
G0 X-18.9697 Y-42.6247 Z38.0637
G0 X-12.3461 Y-45.0859 Z38.2446
G0 X-5.4270 Y-46.5206 Z38.4252
G0 X1.6291 Y-46.8979 Z38.6053
G0 X8.6620 Y-46.2113 Z38.7852
G0 X15.5125 Y-44.4784 Z38.9647
G0 X22.0267 Y-41.7401 Z39.1439
G0 X28.0590 Y-38.0597 Z39.3227
G0 X33.4755 Y-33.5215 Z39.5012
G0 X38.1566 Y-28.2280 Z39.6793
G0 X42.0000 Y-22.2980 Z39.8571
G0 X44.9220 Y-15.8640 Z40.0346
G0 X46.8600 Y-9.0684 Z40.2118
G0 X47.7734 Y-2.0611 Z40.3886
G0 X47.6439 Y5.0044 Z40.5651
G0 X46.4764 Y11.9739 Z40.7413
G0 X44.2981 Y18.6964 Z40.9171
G0 X41.1580 Y25.0271 Z41.0927
G0 X37.1252 Y30.8302 Z41.2679
G0 X32.2881 Y35.9820 Z41.4428
G0 X26.7515 Y40.3736 Z41.6173
G0 X20.6348 Y43.9127 Z41.7916
G0 X14.0688 Y46.5257 Z41.9656
G0 X7.1932 Y48.1589 Z42.1392
G0 X0.1536 Y48.7796 Z42.3125
G0 X-6.9019 Y48.3764 Z42.4856
G0 X-13.8254 Y46.9597 Z42.6583
G0 X-20.4728 Y44.5609 Z42.8307
G0 X-26.7063 Y41.2314 Z43.0028
G0 X-32.3977 Y37.0419 Z43.1747
G0 X-37.4302 Y32.0802 Z43.3462
G0 X-41.7014 Y26.4499 Z43.5174""")
pt = ConstructPoint(XCoordinate=knob, YCoordinate=knob_2, ZCoordinate=knob_3)
panel_4 = Panel("""G0 Y37.5244 Z19.8017 F4800
G0 X-7.0397 Y36.9726 Z20.0264
G0 X-13.8523 Y35.1152 Z20.2505
G0 X-20.2000 Y32.0215 Z20.4739
G0 X-25.8626 Y27.8026 Z20.6966
G0 X-30.6461 Y22.6080 Z20.9187
G0 X-34.3882 Y16.6193 Z21.1402
G0 X-36.9636 Y10.0440 Z21.3610
G0 X-38.2881 Y3.1076 Z21.5812
G0 X-38.3203 Y-3.9542 Z21.8007
G0 X-37.0628 Y-10.9033 Z22.0196
G0 X-34.5611 Y-17.5074 Z22.2379
G0 X-30.9020 Y-23.5476 Z22.4556
G0 X-26.2098 Y-28.8256 Z22.6727
G0 X-20.6417 Y-33.1698 Z22.8892
G0 X-14.3824 Y-36.4405 Z23.1051
G0 X-7.6375 Y-38.5342 Z23.3204
G0 X-0.6266 Y-39.3861 Z23.5351
G0 X6.4238 Y-38.9723 Z23.7492
G0 X13.2878 Y-37.3093 Z23.9628
G0 X19.7473 Y-34.4535 Z24.1758
G0 X25.5988 Y-30.4983 Z24.3882
G0 X30.6593 Y-25.5714 Z24.6000
G0 X34.7724 Y-19.8297 Z24.8113
G0 X37.8122 Y-13.4544 Z25.0220
G0 X39.6872 Y-6.6448 Z25.2322
G0 X40.3426 Y0.3878 Z25.4418
G0 X39.7613 Y7.4269 Z25.6509
G0 X37.9643 Y14.2577 Z25.8594
G0 X35.0091 Y20.6730 Z26.0675
G0 X30.9881 Y26.4801 Z26.2749
G0 X26.0249 Y31.5058 Z26.4819
G0 X20.2702 Y35.6016 Z26.6883
G0 X13.8974 Y38.6479 Z26.8942
G0 X7.0967 Y40.5572 Z27.0996
G0 X0.0698 Y41.2758 Z27.3045
G0 X-6.9769 Y40.7856 Z27.5089
G0 X-13.8375 Y39.1038 Z27.7128
G0 X-20.3133 Y36.2823 Z27.9162
G0 X-26.2180 Y32.4052 Z28.1191
G0 X-31.3832 Y27.5866 Z28.3215
G0 X-35.6629 Y21.9666 Z28.5234
G0 X-38.9371 Y15.7073 Z28.7248
G0 X-41.1155 Y8.9875 Z28.9257
G0 X-42.1392 Y1.9980 Z29.1262
G0 X-41.9822 Y-5.0644 Z29.3262
G0 X-40.6515 Y-12.0022 Z29.5257
G0 X-38.1870 Y-18.6226 Z29.7247
G0 X-34.6594 Y-24.7431 Z29.9233
G0 X-30.1684 Y-30.1961 Z30.1214
G0 X-24.8394 Y-34.8338 Z30.3191
G0 X-18.8198 Y-38.5311 Z30.5163
G0 X-12.2747 Y-41.1900 Z30.7131
G0 X-5.3824 Y-42.7406 Z30.9094
G0 X1.6707 Y-43.1438 Z31.1052
G0 X8.6951 Y-42.3913 Z31.3006
G0 X15.5036 Y-40.5057 Z31.4956
G0 X21.9156 Y-37.5397 Z31.6902
G0 X27.7624 Y-33.5741 Z31.8843
G0 X32.8913 Y-28.7155 Z32.0779
G0 X37.1694 Y-23.0932 Z32.2712
G0 X40.4870 Y-16.8556 Z32.4640
G0 X42.7598 Y-10.1662 Z32.6564
G0 X43.9313 Y-3.1990 Z32.8484
G0 X43.9738 Y3.8660 Z33.0400
G0 X42.8885 Y10.8472 Z33.2311
G0 X40.7056 Y17.5667 Z33.4218
G0 X37.4829 Y23.8541 Z33.6122
G0 X33.3042 Y29.5511 Z33.8021
G0 X28.2768 Y34.5153 Z33.9916
G0 X22.5288 Y38.6237 Z34.1807
G0 X16.2052 Y41.7752 Z34.3694
G0 X9.4648 Y43.8935 Z34.5578
G0 X2.4755 Y44.9282 Z34.7457
G0 X-4.5896 Y44.8559 Z34.9332
G0 X-11.5567 Y43.6807 Z35.1204
G0 X-18.2554 Y41.4337 Z35.3071
G0 X-24.5230 Y38.1717 Z35.4935
G0 X-30.2081 Y33.9762 Z35.6795
G0 X-35.1744 Y28.9503 Z35.8651
G0 X-39.3038 Y23.2168 Z36.0504
G0 X-42.4988 Y16.9146 Z36.2352
G0 X-44.6850 Y10.1955 Z36.4197
G0 X-45.8123 Y3.2202 Z36.6038
G0 X-45.8563 Y-3.8456 Z36.7876
G0 X-44.8179 Y-10.8348 Z36.9710
G0 X-42.7237 Y-17.5832 Z37.1540
G0 X-39.6248 Y-23.9335 Z37.3367
G0 X-35.5955 Y-29.7380 Z37.5190
G0 X-30.7310 Y-34.8631 Z37.7009
G0 X-25.1457 Y-39.1914 Z37.8825
G0 X-18.9697 Y-42.6247 Z38.0637
G0 X-12.3461 Y-45.0859 Z38.2446
G0 X-5.4270 Y-46.5206 Z38.4252
G0 X1.6291 Y-46.8979 Z38.6053
G0 X8.6620 Y-46.2113 Z38.7852
G0 X15.5125 Y-44.4784 Z38.9647
G0 X22.0267 Y-41.7401 Z39.1439
G0 X28.0590 Y-38.0597 Z39.3227
G0 X33.4755 Y-33.5215 Z39.5012
G0 X38.1566 Y-28.2280 Z39.6793
G0 X42.0000 Y-22.2980 Z39.8571
G0 X44.9220 Y-15.8640 Z40.0346
G0 X46.8600 Y-9.0684 Z40.2118
G0 X47.7734 Y-2.0611 Z40.3886
G0 X47.6439 Y5.0044 Z40.5651
G0 X46.4764 Y11.9739 Z40.7413
G0 X44.2981 Y18.6964 Z40.9171
G0 X41.1580 Y25.0271 Z41.0927
G0 X37.1252 Y30.8302 Z41.2679
G0 X32.2881 Y35.9820 Z41.4428
G0 X26.7515 Y40.3736 Z41.6173
G0 X20.6348 Y43.9127 Z41.7916
G0 X14.0688 Y46.5257 Z41.9656
G0 X7.1932 Y48.1589 Z42.1392
G0 X0.1536 Y48.7796 Z42.3125
G0 X-6.9019 Y48.3764 Z42.4856
G0 X-13.8254 Y46.9597 Z42.6583
G0 X-20.4728 Y44.5609 Z42.8307
G0 X-26.7063 Y41.2314 Z43.0028
G0 X-32.3977 Y37.0419 Z43.1747
G0 X-37.4302 Y32.0802 Z43.3462
G0 X-41.7014 Y26.4499 Z43.5174
G0 X-45.1251 Y20.2674 Z43.6883
G0 X-47.6329 Y13.6602 Z43.8589
G0 X-49.1752 Y6.7633 Z44.0293
G0 X-49.7224 Y-0.2827 Z44.1993
G0 X-49.2650 Y-7.3351 Z44.3691
G0 X-47.8139 Y-14.2518 Z44.5385
G0 X-45.4001 Y-20.8941 Z44.7077
G0 X-42.0734 Y-27.1295 Z44.8766
G0 X-37.9017 Y-32.8343 Z45.0452
G0 X-32.9694 Y-37.8960 Z45.2135
G0 X-27.3754 Y-42.2151 Z45.3816
G0 X-21.2313 Y-45.7078 Z45.5494
G0 X-14.6590 Y-48.3067 Z45.7168
G0 X-7.7881 Y-49.9622 Z45.8840
G0 X-0.7535 Y-50.6434 Z46.0510
G0 X6.3075 Y-50.3387 Z46.2176
G0 X13.2576 Y-49.0555 Z46.3840
G0 X19.9624 Y-46.8205 Z46.5501
G0 X26.2931 Y-43.6782 Z46.7160
G0 X32.1283 Y-39.6905 Z46.8816
G0 X37.3569 Y-34.9352 Z47.0469
G0 X41.8801 Y-29.5044 Z47.2119
G0 X45.6128 Y-23.5027 Z47.3767
G0 X48.4853 Y-17.0451 Z47.5412
G0 X50.4446 Y-10.2543 Z47.7054
G0 X51.4550 Y-3.2591 Z47.8694
G0 X51.4994 Y3.8085 Z48.0331
G0 X50.5782 Y10.8161 Z48.1966
G0 X48.7103 Y17.6326 Z48.3598
G0 X45.9316 Y24.1314 Z48.5228
G0 X42.2955 Y30.1923 Z48.6855
G0 X37.8706 Y35.7037 Z48.8479
G0 X32.7397 Y40.5648 Z49.0101
G0 X26.9983 Y44.6870 Z49.1720
G0 X20.7527 Y47.9959 Z49.3337
G0 X14.1179 Y50.4322 Z49.4952
G0 X7.2154 Y51.9530 Z49.6564
G0 X0.1711 Y52.5319 Z49.8173
G0 X-6.8872 Y52.1598 Z49.9780
G0 X-13.8319 Y50.8448 Z50.1384
G0 X-20.5382 Y48.6123 Z50.2987
G0 X-26.8860 Y45.5035 Z50.4586
G0 X-32.7621 Y41.5754 Z50.6183
G0 X-38.0624 Y36.8993 Z50.7778
G0 X-42.6936 Y31.5597 Z50.9371
G0 X-46.5745 Y25.6522 Z51.0961
G0 X-49.6374 Y19.2820 Z51.2549
G0 X-51.8295 Y12.5622 Z51.4134
G0 X-53.1137 Y5.6116 Z51.5717
G0 X-53.4688 Y-1.4478 Z51.7297
G0 X-52.8899 Y-8.4924 Z51.8876
G0 X-51.3883 Y-15.3994 Z52.0452
G0 X-48.9917 Y-22.0491 Z52.2025
G0 X-45.7428 Y-28.3266 Z52.3597
G0 X-41.6990 Y-34.1240 Z52.5166
G0 X-36.9309 Y-39.3421 Z52.6733
G0 X-31.5217 Y-43.8921 Z52.8297
G0 X-25.5648 Y-47.6973 Z52.9859
G0 X-19.1628 Y-50.6935 Z53.1419
G0 X-12.4251 Y-52.8309 Z53.2977
G0 X-5.4669 Y-54.0744 Z53.4533
G0 X1.5940 Y-54.4045 Z53.6086
G0 X8.6381 Y-53.8166 Z53.7637
G0 X15.5468 Y-52.3218 Z53.9186
G0 X22.2045 Y-49.9468 Z54.0733
G0 X28.5000 Y-46.7326 Z54.2277
G0 X34.3288 Y-42.7337 Z54.3820
G0 X39.5944 Y-38.0178 Z54.5360
G0 X44.2104 Y-32.6644 Z54.6898
G0 X48.1012 Y-26.7629 Z54.8434
G0 X51.2035 Y-20.4113 Z54.9968
G0 X53.4674 Y-13.7149 Z55.1499
G0 X54.8570 Y-6.7841 Z55.3029
G0 X55.3507 Y0.2674 Z55.4556
G0 X54.9415 Y7.3244 Z55.6081
G0 X53.6374 Y14.2719 Z55.7605
G0 X51.4609 Y20.9973 Z55.9126
G0 X48.4484 Y27.3920 Z56.0645
G0 X44.6493 Y33.3533 Z56.2162
G0 X40.1263 Y38.7857 Z56.3677
G0 X34.9529 Y43.6028 Z56.5190
G0 X29.2126 Y47.7282 Z56.6700
G0 X22.9979 Y51.0969 Z56.8209
G0 X16.4087 Y53.6564 Z56.9716
G0 X9.5498 Y55.3670 Z57.1221
G0 X2.5304 Y56.2027 Z57.2723
G0 X-4.5384 Y56.1515 Z57.4224
G0 X-11.5452 Y55.2155 Z57.5723
G0 X-18.3799 Y53.4105 Z57.7219
G0 X-24.9356 Y50.7657 Z57.8714
G0 X-31.1101 Y47.3239 Z58.0207
G0 X-36.8079 Y43.1396 Z58.1698
G0 X-41.9406 Y38.2789 Z58.3187
G0 X-46.4296 Y32.8180 Z58.4674
G0 X-50.2064 Y26.8423 Z58.6159
G0 X-53.2133 Y20.4446 Z58.7642
G0 X-55.4052 Y13.7238 Z58.9123
G0 X-56.7495 Y6.7837 Z59.0602
G0 X-57.2269 Y-0.2694 Z59.2079
G0 X-56.8308 Y-7.3275 Z59.3554
G0 X-55.5685 Y-14.2831 Z59.5028
G0 X-53.4606 Y-21.0308 Z59.6500
G0 X-50.5397 Y-27.4684 Z59.7969
G0 X-46.8511 Y-33.4991 Z59.9437
G0 X-42.4516 Y-39.0325 Z60.0903
G0 X-37.4080 Y-43.9860 Z60.2367
G0 X-31.7968 Y-48.2859 Z60.3829
G0 X-25.7027 Y-51.8689 Z60.5290
G0 X-19.2174 Y-54.6824 Z60.6748
G0 X-12.4377 Y-56.6853 Z60.8205
G0 X-5.4647 Y-57.8489 Z60.9660
G0 X1.5979 Y-58.1572 Z61.1113
G0 X8.6459 Y-57.6066 Z61.2564
G0 X15.5752 Y-56.2060 Z61.4014
G0 X22.2842 Y-53.9775 Z61.5462
G0 X28.6747 Y-50.9546 Z61.6908
G0 X34.6536 Y-47.1824 Z61.8352
G0 X40.1343 Y-42.7170 Z61.9794
G0 X45.0375 Y-37.6243 Z62.1235
G0 X49.2926 Y-31.9787 Z62.2673
G0 X52.8389 Y-25.8630 Z62.4110
G0 X55.6261 Y-19.3661 Z62.5546
G0 X57.6146 Y-12.5820 Z62.6979
G0 X58.7770 Y-5.6086 Z62.8411
G0 X59.0977 Y1.4537 Z62.9841
G0 X58.5729 Y8.5037 Z63.1269
G0 X57.2111 Y15.4409 Z63.2696
G0 X55.0330 Y22.1667 Z63.4121
G0 X52.0703 Y28.5855 Z63.5544
G0 X48.3658 Y34.6069 Z63.6966
G0 X43.9730 Y40.1461 Z63.8385
G0 X38.9547 Y45.1257 Z63.9803
G0 X33.3819 Y49.4760 Z64.1220
G0 X27.3340 Y53.1370 Z64.2635
G0 X20.8959 Y56.0580 Z64.4048
G0 X14.1582 Y58.1990 Z64.5459
G0 X7.2151 Y59.5313 Z64.6869
G0 X0.1635 Y60.0372 Z64.8277
G0 X-6.8987 Y59.7104 Z64.9683
G0 X-13.8737 Y58.5568 Z65.1088
G0 X-20.6653 Y56.5931 Z65.2491
G0 X-27.1800 Y53.8472 Z65.3893
G0 X-33.3288 Y50.3579 Z65.5293
G0 X-39.0276 Y46.1739 Z65.6691
G0 X-44.1989 Y41.3531 Z65.8088
G0 X-48.7728 Y35.9622 Z65.9483
G0 X-52.6878 Y30.0753 Z66.0876
G0 X-55.8912 Y23.7727 Z66.2268
G0 X-58.3405 Y17.1407 Z66.3658
G0 X-60.0035 Y10.2692 Z66.5047
G0 X-60.8584 Y3.2511 Z66.6434
G0 X-60.8948 Y-3.8187 Z66.7820
G0 X-60.1133 Y-10.8453 Z66.9204
G0 X-58.5248 Y-17.7345 Z67.0586
G0 X-56.1518 Y-24.3943 Z67.1967
G0 X-53.0269 Y-30.7362 Z67.3346
G0 X-49.1923 Y-36.6759 Z67.4724
G0 X-44.6999 Y-42.1351 Z67.6100
G0 X-39.6101 Y-47.0421 Z67.7475
G0 X-33.9905 Y-51.3322 Z67.8848
G0 X-27.9161 Y-54.9499 Z68.0219
G0 X-21.4674 Y-57.8482 Z68.1589
G0 X-14.7295 Y-59.9895 Z68.2958
G0 X-7.7909 Y-61.3470 Z68.4325
G0 X-0.7428 Y-61.9036 Z68.5691
G0 X6.3228 Y-61.6528 Z68.7055
G0 X13.3139 Y-60.5990 Z68.8417
G0 X20.1398 Y-58.7567 Z68.9778
G0 X26.7120 Y-56.1503 Z69.1138
G0 X32.9459 Y-52.8149 Z69.2496
G0 X38.7613 Y-48.7940 Z69.3852
G0 X44.0838 Y-44.1402 Z69.5207
G0 X48.8456 Y-38.9141 Z69.6561
G0 X52.9861 Y-33.1831 Z69.7913
G0 X56.4529 Y-27.0213 Z69.9264
G0 X59.2029 Y-20.5078 Z70.0613
G0 X61.2012 Y-13.7258 Z70.1961
G0 X62.4236 Y-6.7621 Z70.3307
G0 X62.8555 Y0.2949 Z70.4652
G0 X62.4918 Y7.3558 Z70.5996
G0 X61.3384 Y14.3313 Z70.7338
G0 X59.4105 Y21.1337 Z70.8678
G0 X56.7331 Y27.6774 Z71.0017
G0 X53.3407 Y33.8807 Z71.1355
G0 X49.2766 Y39.6662 Z71.2692
G0 X44.5921 Y44.9619 Z71.4026
G0 X39.3465 Y49.7025 Z71.5360
G0 X33.6056 Y53.8293 Z71.6692
G0 X27.4411 Y57.2918 Z71.8023
G0 X20.9301 Y60.0480 Z71.9352
G0 X14.1533 Y62.0641 Z72.0680
G0 X7.1947 Y63.3163 Z72.2007
G0 X0.1402 Y63.7900 Z72.3332
G0 X-6.9234 Y63.4798 Z72.4656
G0 X-13.9094 Y62.3907 Z72.5978
G0 X-20.7324 Y60.5367 Z72.7299
G0 X-27.3091 Y57.9411 Z72.8619
G0 X-33.5598 Y54.6366 Z72.9938
G0 X-39.4086 Y50.6639 Z73.1255
G0 X-44.7849 Y46.0719 Z73.2570
G0 X-49.6243 Y40.9171 Z73.3885
G0 X-53.8683 Y35.2621 Z73.5197
G0 X-57.4668 Y29.1758 Z73.6509
G0 X-60.3770 Y22.7320 Z73.7819
G0 X-62.5643 Y16.0083 Z73.9128
G0 X-64.0036 Y9.0859 Z74.0436
G0 X-64.6782 Y2.0476 Z74.1742
G0 X-64.5808 Y-5.0222 Z74.3047
G0 X-63.7136 Y-12.0393 Z74.4351
G0 X-62.0873 Y-18.9203 Z74.5654
G0 X-59.7221 Y-25.5836 Z74.6955
G0 X-56.6471 Y-31.9504 Z74.8254
G0 X-52.8987 Y-37.9456 Z74.9553
G0 X-48.5225 Y-43.4992 Z75.0850
G0 X-43.5702 Y-48.5458 Z75.2146
G0 X-38.1008 Y-53.0267 Z75.3441
G0 X-32.1790 Y-56.8900 Z75.4734
G0 X-25.8744 Y-60.0909 Z75.6026
G0 X-19.2612 Y-62.5928 Z75.7317
G0 X-12.4168 Y-64.3672 Z75.8606
G0 X-5.4211 Y-65.3938 Z75.9895
G0 X1.6445 Y-65.6620 Z76.1182
G0 X8.6979 Y-65.1690 Z76.2467
G0 X15.6576 Y-63.9213 Z76.3752
G0 X22.4433 Y-61.9343 Z76.5035
G0 X28.9769 Y-59.2311 Z76.6317
G0 X35.1836 Y-55.8441 Z76.7598
G0 X40.9923 Y-51.8125 Z76.8877
G0 X46.3368 Y-47.1830 Z77.0156
G0 X51.1566 Y-42.0096 Z77.1433
G0 X55.3969 Y-36.3514 Z77.2709
G0 X59.0101 Y-30.2736 Z77.3983
G0 X61.9559 Y-23.8457 Z77.5256
G0 X64.2010 Y-17.1408 Z77.6529
G0 X65.7212 Y-10.2354 Z77.7799
G0 X66.4996 Y-3.2076 Z77.9069
G0 X66.5283 Y3.8631 Z78.0338
G0 X65.8077 Y10.8971 Z78.1605
G0 X64.3463 Y17.8152 Z78.2871
G0 X62.1617 Y24.5401 Z78.4136
G0 X59.2786 Y30.9964 Z78.5400
G0 X55.7302 Y37.1123 Z78.6662
G0 X51.5566 Y42.8201 Z78.7923
G0 X46.8047 Y48.0561 Z78.9184
G0 X41.5282 Y52.7631 Z79.0442
G0 X35.7859 Y56.8889 Z79.1700
G0 X29.6418 Y60.3886 Z79.2957
G0 X23.1645 Y63.2242 Z79.4212
G0 X16.4253 Y65.3646 Z79.5466
G0 X9.4990 Y66.7873 Z79.6720
G0 X2.4619 Y67.4772 Z79.7971
G0 X-4.6089 Y67.4272 Z79.9222
G0 X-11.6357 Y66.6389 Z80.0472
G0 X-18.5418 Y65.1212 Z80.1720
G0 X-25.2521 Y62.8917 Z80.2968
G0 X-31.6934 Y59.9750 Z80.4214
G0 X-37.7962 Y56.4036 Z80.5459
G0 X-43.4945 Y52.2170 Z80.6703
G0 X-48.7267 Y47.4607 Z80.7945
G0 X-53.4371 Y42.1871 Z80.9187
G0 X-57.5750 Y36.4533 Z81.0427
G0 X-61.0964 Y30.3215 Z81.1667
G0 X-63.9642 Y23.8582 Z81.2905
G0 X-66.1477 Y17.1328 Z81.4142
G0 X-67.6248 Y10.2178 Z81.5378
G0 X-68.3799 Y3.1872 Z81.6613
G0 X-68.4056 Y-3.8838 Z81.7847
G0 X-67.7025 Y-10.9198 Z81.9079
G0 X-66.2784 Y-17.8459 Z82.0311
G0 X-64.1495 Y-24.5889 Z82.1541
G0 X-61.3385 Y-31.0772 Z82.2771
G0 X-57.8762 Y-37.2425 Z82.3999
G0 X-53.7995 Y-43.0201 Z82.5226
G0 X-49.1518 Y-48.3492 Z82.6452
G0 X-43.9829 Y-53.1745 Z82.7677
G0 X-38.3472 Y-57.4451 Z82.8901
G0 X-32.3044 Y-61.1174 Z83.0124
G0 X-25.9181 Y-64.1530 Z83.1345
G0 X-19.2552 Y-66.5209 Z83.2566
G0 X-12.3857 Y-68.1972 Z83.3786
G0 X-5.3810 Y-69.1646 Z83.5004
G0 X1.6857 Y-69.4141 Z83.6221
G0 X8.7411 Y-68.9434 Z83.7438
G0 X15.7122 Y-67.7582 Z83.8653
G0 X22.5270 Y-65.8714 Z83.9867
G0 X29.1152 Y-63.3028 Z84.1081
G0 X35.4092 Y-60.0800 Z84.2293
G0 X41.3443 Y-56.2360 Z84.3504
G0 X46.8602 Y-51.8115 Z84.4714
G0 X51.9004 Y-46.8519 Z84.5923
G0 X56.4139 Y-41.4085 Z84.7131
G0 X60.3552 Y-35.5375 Z84.8337
G0 X63.6841 Y-29.2989 Z84.9543
G0 X66.3678 Y-22.7568 Z85.0748
G0 X68.3792 Y-15.9776 Z85.1952
G0 X69.6986 Y-9.0306 Z85.3155
G0 X70.3133 Y-1.9861 Z85.4356
G0 X70.2174 Y5.0845 Z85.5557
G0 X69.4130 Y12.1098 Z85.6757
G0 X67.9081 Y19.0191 Z85.7955
G0 X65.7191 Y25.7430 Z85.9153
G0 X62.8681 Y32.2141 Z86.0350
G0 X59.3844 Y38.3677 Z86.1545
G0 X55.3035 Y44.1426 Z86.2740
G0 X50.6665 Y49.4812 Z86.3933
G0 X45.5203 Y54.3310 Z86.5126
G0 X39.9163 Y58.6436 Z86.6318
G0 X33.9109 Y62.3771 Z86.7508
G0 X27.5638 Y65.4944 Z86.8698
G0 X20.9383 Y67.9656 Z86.9886
G0 X14.1002 Y69.7666 Z87.1074
G0 X7.1171 Y70.8800 Z87.2261
G0 X0.0580 Y71.2958 Z87.3446
G0 X-7.0076 Y71.0100 Z87.4631
G0 X-14.0102 Y70.0265 Z87.5814
G0 X-20.8812 Y68.3550 Z87.6997
G0 X-27.5534 Y66.0128 Z87.8179
G0 X-33.9618 Y63.0233 Z87.9360
G0 X-40.0439 Y59.4160 Z88.0539
G0 X-45.7409 Y55.2269 Z88.1718
G0 X-50.9974 Y50.4969 Z88.2896
G0 X-55.7632 Y45.2726 Z88.4073
G0 X-59.9919 Y39.6049 Z88.5249
G0 X-63.6434 Y33.5492 Z88.6424
G0 X-66.6827 Y27.1643 Z88.7597
G0 X-69.0810 Y20.5120 Z88.8770
G0 X-70.8159 Y13.6567 Z88.9943
G0 X-71.8707 Y6.6643 Z89.1114
G0 X-72.2367 Y-0.3976 Z89.2284
G0 X-71.9100 Y-7.4615 Z89.3453
G0 X-70.8950 Y-14.4598 Z89.4621
G0 X-69.2015 Y-21.3255 Z89.5789
G0 X-66.8465 Y-27.9933 Z89.6955
G0 X-63.8528 Y-34.3998 Z89.8120
G0 X-60.2494 Y-40.4843 Z89.9285
G0 X-56.0712 Y-46.1894 Z90.0449
G0 X-51.3578 Y-51.4611 Z90.1611
G0 X-46.1548 Y-56.2501 Z90.2773
G0 X-40.5113 Y-60.5112 Z90.3934
G0 X-34.4812 Y-64.2050 Z90.5094
G0 X-28.1214 Y-67.2968 Z90.6252
G0 X-21.4921 Y-69.7582 Z90.7410
G0 X-14.6557 Y-71.5667 Z90.8568
G0 X-7.6764 Y-72.7055 Z90.9724
G0 X-0.6198 Y-73.1649 Z91.0879
G0 X6.4482 Y-72.9406 Z91.2033
G0 X13.4616 Y-72.0359 Z91.3187
G0 X20.3551 Y-70.4591 Z91.4339
G0 X27.0648 Y-68.2259 Z91.5491
G0 X33.5284 Y-65.3572 Z91.6642
G0 X39.6862 Y-61.8803 Z91.7792
G0 X45.4814 Y-57.8279 Z91.8941
G0 X50.8607 Y-53.2376 Z92.0089
G0 X55.7750 Y-48.1526 Z92.1236
G0 X60.1790 Y-42.6198 Z92.2382
G0 X64.0330 Y-36.6907 Z92.3527
G0 X67.3015 Y-30.4197 Z92.4672
G0 X69.9556 Y-23.8651 Z92.5816
G0 X71.9708 Y-17.0867 Z92.6958
G0 X73.3298 Y-10.1469 Z92.8100
G0 X74.0203 Y-3.1090 Z92.9241
G0 X74.0365 Y3.9626 Z93.0381
G0 X73.3791 Y11.0036 Z93.1520
G0 X72.0541 Y17.9500 Z93.2659
G0 X70.0747 Y24.7390 Z93.3796
G0 X67.4585 Y31.3089 Z93.4933
G0 X64.2305 Y37.6008 Z93.6068
G0 X60.4195 Y43.5578 Z93.7203
G0 X56.0610 Y49.1267 Z93.8337
G0 X51.1942 Y54.2572 Z93.9470
G0 X45.8636 Y58.9041 Z94.0603
G0 X40.1172 Y63.0257 Z94.1734
G0 X34.0066 Y66.5851 Z94.2865
G0 X27.5872 Y69.5516 Z94.3994
G0 X20.9166 Y71.8996 Z94.5123
G0 X14.0541 Y73.6067 Z94.6251
G0 X7.0609 Y74.6581 Z94.7378
G0 X0.0000 Y75.0488 Z94.8505
M104 S0 ; turn off all temperature
M140 S0 ; turn off bed
G28 ; Home all
M84 ; Disable all motor""")
pathtranslate_2 = TranslationPath(PathGeometry=pt, ToolOrientation=PlaneXY(0, 0, 0), FeedRate=3600)  # -> BeaverPath, Test
panel_5 = Panel("""G1 Z200 F3000
G1 Z220
G1 Z200
G1 Z220
G1 Z200
G1 Z220
G1 Z200
G1 Z220
G1 Z200
G1 Z220
G1 Z200
G1 Z201
G1 Z200
G1 Z201
G1 Z200
G1 Z201
G1 Z200
G1 Z201
G1 Z200
G1 Z201
G1 Z200
G1 Z201
G1 Z200
G1 Z201
G1 Z200
G1 Z201
G1 Z200
G1 Z201""")
wq = WriteQueue(String="G28", Send=Toggle(False))
pathgcode_2 = PathToGcode(Path=pathtranslate_2.BeaverPath, Precision=4, UseAbsolutePosition=True, UseAbsoluteE=True)  # -> Gcode, Message
rw = ReadWrite()  # -> PrinterLogs, Queue
connect = ConnectToPrinter(Port="COM6", Baud=115200, Open=Toggle(False))  # -> Message, Debug
wq_2 = WriteQueue(String="G28", Send=Button())
panel_6 = Panel(rw.PrinterLogs)
panel_7 = Panel(connect.Message)
panel_8 = Panel(wq_2)
panel_9 = Panel(rw.Queue)
timer = Timer(TimerInterval=20, Target=counter)
counter = Counter(Reset=Toggle(True))
panel_10 = Panel(counter)
sphere = PalmedSphere(TFrame=counter)  # -> Position, Radius, Direction
panel_11 = Panel(sphere.Radius)
panel_12 = Panel(sphere.Direction)
panel_13 = Panel(sphere.Position)
